% Simulink data dictionary sldemo_fuelsys_original.sldd

AF_sensor_tol = 1

EngSensors = Simulink.Bus()
  throttle: s16En3, Unit="deg"
  speed: s16En3, Unit="rad/s"
  ego: s16En7, Unit="V"
  map: u8En7, Unit="bar"

MAF_sensor_tol = 1
ego_sw = 1
fault_time = 50
fuel_inj_tol = 1
hys = 25
kappa_tol = 1
ki = 0.14
kp = 0.04
map_sw = 1
max_ego = 1.2
max_press = 0.95
max_rob = 20
max_speed = 628
max_throt = 90
mdl = "sldemo_fuelsys_original"
min_press = 0.05
min_throt = 3
pump_tol = 1
s16En15 = Simulink.NumericType(DataTypeMode="Single", SignednessBool=true, WordLength=32, FixedExponent=0)
s16En3 = Simulink.NumericType(DataTypeMode="Single", SignednessBool=true, WordLength=32, FixedExponent=0)
s16En7 = Simulink.NumericType(DataTypeMode="Single", SignednessBool=true, WordLength=32, FixedExponent=0)
speed_sw = 1
st_range = 0.0001
t__ = [0; 0.01; 0.02; 0.03; 0.04; 0.05; 0.06; 0.07; 0.08; 0.09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 30]
tau_ww_tol = 1
throttle_sw = 1
tspan = [0 1]
u8En7 = Simulink.NumericType(DataTypeMode="Single", SignednessBool=true, WordLength=32, FixedExponent=0)

u__ = [300 0
 300 0
 300 0
 300 0
 300 0
 300 0
 300 0
 300 0
 300 0
 300 0
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 ]

zero_thresh = 250